% Simulink data dictionary Adoptive_cruse_control_data.sldd

Time_Gap = Simulink.Signal(DataType="uint8", Min=0, Max=255)
Set_Speed = Simulink.Signal(DataType="uint8", Min=0, Max=255)
CruiseSwitch = Simulink.Signal(DataType="boolean", Min=0, Max=1)
SetSwitch = Simulink.Signal(DataType="boolean", Min=0, Max=1)
CameraInput_LeadVehicle = Simulink.Signal(DataType="uint8", Min=0, Max=255)
RadarInput_LeadVehicle = Simulink.Signal(DataType="uint8", Min=0, Max=255)
CameraInput_DriveVehicle = Simulink.Signal(DataType="uint8", Min=0, Max=255)
Acceleration_Mode = Simulink.Signal(DataType="uint8", Min=0, Max=5)
Set_Gap = Simulink.Signal(DataType="uint8", Min=0, Max=255)
Acceleration_Mode1 = Simulink.Signal(DataType="uint8", Min=0, Max=5)
RadarInput_DriveVehicle = Simulink.Signal(DataType="uint8", Min=0, Max=255, Dimensions=2)